# Dynamo graph adder_filter.dyn "First" (Dynamo 2.6.1.8786)
# packages: PyScript 0.0.7

# group: Input
n1_имя_фильтра = StringInput("Interior")  # "1. Имя фильтра"; graph input
n2_цвет_hex = StringInput("#ff0000")  # "2. Цвет(HEX)"; graph input
n3_видимый = BoolSelector(true)  # "3. Видимый"; graph input
n4_полутон = BoolSelector(true)  # "4. Полутон"; graph input

list_create = List.Create(item0=n1_имя_фильтра, item1=n2_цвет_hex, item2=n3_видимый, item3=n4_полутон)
execute = PyScript.Script.Execute(IN=list_create)
log = Watch(execute.output)  # graph output
