# Dynamo graph color_param.dyn (Dynamo 2.6.1.8786)
# packages: PyScript 0.0.7

parameter_name = StringInput("RC_Level")  # graph input
visible = BoolSelector(true)  # graph input
halftone = BoolSelector(false)  # graph input
list_create = List.Create(item0=parameter_name, item1=visible, item2=halftone)
execute = PyScript.Script.Execute(IN=list_create)
log = Watch(execute.output)  # graph output
parameter_s_values = Watch(execute.OUT)  # graph output
