# Dynamo graph create_callout.dyn (Dynamo 2.6.1.8786)
# packages: PyScript 0.0.7

offset = DoubleInput(2)  # graph input
rotate = BoolSelector(true)  # graph input
along_section = BoolSelector(true)  # graph input
along_section_other_side = BoolSelector(false)  # graph input
across_section = BoolSelector(true)  # graph input
list_create = List.Create(item0=offset, item1=rotate, item2=along_section, item3=along_section_other_side, item4=across_section)
execute = PyScript.Script.Execute(IN=list_create)
log = Watch(execute.output)  # graph output
return_ = Watch(execute.OUT)  # graph output
