# Dynamo graph create_facade_by_line.dyn "facade" (Dynamo 2.6.1.8786)
# packages: PyScript 0.0.7

# group: Inputs
offset = DoubleInput(5)  # graph input
height_section = DoubleInput(15)  # graph input
shift_bound = DoubleInput(1)  # graph input
depth_far_clip = DoubleInput(15)  # graph input
right_side = BoolSelector(true)  # graph input
delete_elevation_in_selection = BoolSelector(false)  # graph input

list_create = List.Create(item0=offset, item1=height_section, item2=shift_bound, item3=depth_far_clip, item4=right_side, item5=delete_elevation_in_selection)
execute = PyScript.Script.Execute(IN=list_create)
log = Watch(execute.output)  # graph output
return_ = Watch(execute.OUT)  # graph output
