# Dynamo graph del_filters_by_name.dyn (Dynamo 2.6.1.8786)
# packages: PyScript 0.0.7

название_фильтра = StringInput("RC_GEN_Level")  # graph input
list_create = List.Create(item0=название_фильтра)
execute = PyScript.Script.Execute(IN=list_create)
log = Watch(execute.output)  # graph output
