# Dynamo graph dim_axles.dyn (Dynamo 2.6.1.8786)
# packages: PyScript 0.0.7

create_dimension = BoolSelector(true)  # graph input
create_second_dimension = BoolSelector(true)  # graph input
crop_axles = BoolSelector(true)  # graph input
update_bubbles = BoolSelector(true)  # graph input
list_create = List.Create(item0=create_dimension, item1=create_second_dimension, item2=crop_axles, item3=update_bubbles)
execute = PyScript.Script.Execute(IN=list_create)
log = Watch(execute.output)  # graph output
return_ = Watch(execute.OUT)
