# Dynamo graph dim_colum.dyn (Dynamo 2.6.1.8786)
# packages: PyScript 0.0.7

коэф_отступа_размерной_линии = DoubleInput(1)  # graph input
коэф_ширины_опр_смещать_или_нет = DoubleInput(1)  # graph input
коэф_пространства_при_смещении = DoubleInput(0.8)  # graph input
level_loging = StringInput("INFO")  # graph input
list_create = List.Create(item0=коэф_отступа_размерной_линии, item1=коэф_ширины_опр_смещать_или_нет, item2=коэф_пространства_при_смещении, item3=level_loging)
execute = PyScript.Script.Execute(IN=list_create)
log = Watch(execute.output)  # graph output
return_ = Watch(execute.OUT)  # graph output
