# Dynamo graph fill_by_id.dyn (Dynamo 2.6.1.8786)
# packages: PyScript 0.0.7

# group: Fill by id
# note: Данный скрипт заполняет необходимый параметр у элементов по id и значению

# group: INPUTS
# note: 1. Parameter name to fill
# 2. Path to file with data
# Data must be separeted by ", "

# group: PACKAGES
# note: Need PyScript
# And folder "my_class" near the script

# group: Input
parameter_name = StringInput("RC_GEN_Comment")  # graph input
path_to_data_file = StringInput("C:\Dynamo\Dynamo_scripts\scripts\data\data.csv")  # graph input

list_create = List.Create(item0=parameter_name, item1=path_to_data_file)
execute = PyScript.Script.Execute(IN=list_create)
log = Watch(execute.output)  # graph output
return_ = Watch(execute.OUT)  # graph output
