# Dynamo graph rebar.dyn (Dynamo 2.6.1.8786)
# packages: PyScript 0.0.7

in_0_str = StringInput("")  # graph input
in_1_int = DoubleInput(0)  # graph input
in_2_str = StringInput("")  # graph input
in_3_int = IntegerSlider(0, range=0..25 step 1)  # graph input
in_4_element = DSModelElementSelection()  # 1 picked in the model; graph input
in_5_element = DSModelElementSelection()  # nothing selected; graph input
list_create = List.Create(item0=in_0_str, item1=in_1_int, item2=in_2_str, item3=in_3_int, item4=in_4_element, item5=in_5_element)
execute = PyScript.Script.Execute(IN=list_create)
log = Watch(execute.output)  # graph output
return_ = Watch(execute.OUT)  # graph output
