# Dynamo graph rebar_invisible.dyn "rebar_visible" (Dynamo 2.6.1.8786)
# packages: PyScript 0.0.7

only_selected = BoolSelector(false)  # graph input
list_create = List.Create(item0=only_selected)
execute = PyScript.Script.Execute(IN=list_create)
log = Watch(execute.output)  # graph output
