# Dynamo graph reload_number.dyn (Dynamo 2.6.1.8786)
# packages: PyScript 0.0.7

just_update_or_create = BoolSelector(false)  # graph input
list_create = List.Create(item0=just_update_or_create)
execute = PyScript.Script.Execute(IN=list_create)
log = Watch(execute.output)  # graph output
return_ = Watch(execute.OUT)  # graph output
