# Dynamo graph Создать-разрез-по-оси.dyn "Разрез создать по Оси" (Dynamo 2.0.3.8810)

# note: Так же можно добавить возможность создание разреза по выбранной линии из проекта, или написать аналогичный скрипт для линий.

оси = CodeBlock { Category.ByName("OST_Grids"); }
all_elements_of_category = ElementsOfCategory(Category=оси)
# note: Можно сделать выбор по нескольким осям.
# Добавить вначало скрипта список осей.
# Или написать еще один скрипт.
# note: Сделать проверку на имя вида, в случае совпадения добавить суффикс
выбрать_ось_по_имени = StringInput("1ов")  # graph input
string_from_object = FromObject(obj=выбрать_ось_по_имени)
code_block = CodeBlock(G=all_elements_of_category, G1=string_from_object)
# ---------- code_block.designscript (10 lines) ----------
//Все имена Осей в проекте
t4 = String.Join(",", [List.Chop(G.Name, 10)]);
t5 = List.Flatten(t4);
//ВЫбранная Ось для разреза
G2=G[List.AllIndicesOf(G1==G.Name, true)];
G2.Name;
//Геометрия Оси со средней точкой и плоскт.в точке
c1 = Grid.Curve(G2);
p1=Curve.PointAtParameter(c1,0.5);
Pl1=Curve.PlaneAtParameter(c1,0.5);
# ----------------------------------------
code_block_2 = CodeBlock(w=code_block.Pl1) { w; }
имя_осей_в_проекте = Watch(code_block.t5)  # graph output
# note: Ось Х будет задавать верхнюю и нижнию границу сечения
code_block_3 = CodeBlock(p1=code_block.p1) { p1; }
YAxis = Plane.YAxis(plane=code_block.Pl1)
reverse = Vector.Reverse(vector=YAxis)
byOriginNormal = Plane.ByOriginNormal(origin=code_block.p1, normal=reverse)
toCoordinateSystem = Plane.ToCoordinateSystem(plane=byOriginNormal)

# group: Проверочная система координат
code_block_4 = CodeBlock(p1=code_block_3) { p1; }
XAxis = CoordinateSystem.XAxis(coordinateSystem=toCoordinateSystem)
code_block_5 = CodeBlock { 5000; 5000; 9000; }
byStartPointDirectionLength = Line.ByStartPointDirectionLength(startPoint=code_block_4, direction=XAxis, length=code_block_5.out0)
YAxis_2 = CoordinateSystem.YAxis(coordinateSystem=toCoordinateSystem)
byStartPointDirectionLength_2 = Line.ByStartPointDirectionLength(startPoint=code_block_4, direction=YAxis_2, length=code_block_5.out1)
ZAxis = CoordinateSystem.ZAxis(coordinateSystem=toCoordinateSystem)
byStartPointDirectionLength_3 = Line.ByStartPointDirectionLength(startPoint=code_block_4, direction=ZAxis, length=code_block_5.out2)

отметка_низ_сечения = DoubleInput(-200)  # graph input
code_block_6 = CodeBlock(c1=code_block.c1) { c1; }
length = Curve.Length(curve=code_block_6)
code_block_7 = CodeBlock(l=length) { -l/2; l/2; 0; }
byCoordinates = Point.ByCoordinates(x=отметка_низ_сечения, y=code_block_7.out0, z=code_block_7.out2)
отметка_верх_сечения = DoubleInput(1800)  # graph input
отметка_глубины_сечения = DoubleInput(1000)  # graph input
byCoordinates_2 = Point.ByCoordinates(x=отметка_верх_сечения, y=code_block_7.out1, z=отметка_глубины_сечения)
byCoordinateSystemMinPointMaxPoint = SectionView.ByCoordinateSystemMinPointMaxPoint(cs=toCoordinateSystem, minPoint=byCoordinates, maxPoint=byCoordinates_2)
code_block_8 = CodeBlock { "Имя вида"; }
назначить_имя_вида = StringInput("Разрез по Оси")  # graph input
имя_разреза = CodeBlock(n1=назначить_имя_вида, n2=string_from_object) { n1+" "+n2; }
setParameterByName = Element.SetParameterByName(element=byCoordinateSystemMinPointMaxPoint, parameterName=code_block_8, value=имя_разреза)
getParameterValueByName = Element.GetParameterValueByName(element=setParameterByName, parameterName=code_block_8)
имя_разреза_2 = Watch(getParameterValueByName)  # graph output
desc = StringInput("""sashtet@yandex.ru 
Назначение скрипта: 
 =>Создание Разреза по выбранной оси из проекта.
=>Назначить Имя вида. 
=>Назначить Ось для Разреза. 
=>Назначить геометрию разреза.

Пользовательских нодов нет.
Имя вида не должно совпадать с ранее созданными.
""")  # graph input
