# Dynamo graph wall_join.dyn (Dynamo 2.6.1.8786)

join_start = BoolSelector(false)  # graph input
join_end = BoolSelector(false)  # graph input
python_script = Python(IN[0]=join_start, IN[1]=join_end)
# ---------- python_script.python (105 lines) ----------
# Загрузить стандартную библиотеку Python и библиотеку DesignScript
import sys
import clr

clr.AddReference('RevitAPI')
import Autodesk.Revit.DB as DB
clr.AddReference("RevitServices")
from RevitServices.Persistence import DocumentManager
from RevitServices.Transactions import TransactionManager

doc = DocumentManager.Instance.CurrentDBDocument
uiapp = DocumentManager.Instance.CurrentUIApplication
app = uiapp.Application
uidoc = uiapp.ActiveUIDocument


def for_each(f):
    selection = uidoc.Selection.GetElementIds()
    for e_id in selection:
        element = doc.GetElement(e_id)
        f(element)


def get_selected(as_list=False):
    if as_list:
        return list(_get_selected())
    return _get_selected()


def _get_selected():
    selection = uidoc.Selection.GetElementIds()
    for e_id in selection:
        element = doc.GetElement(e_id)
        yield element


def get_selected_by_cat(cat, as_list=False):
    """
    Получить элементы в пользовательском выборе определенной категории

    :param cat: BuiltInCategory
    :type cat: DB.BuiltInCategory
    :param as_list: Вернуть лист или генератор
    :type as_list: bool
    :return: Элементы опр. категории выбранные пользователем
    :rtype: DB.Element
    """

    if as_list:
        return list(_get_selected_by_cat(cat))
    return _get_selected_by_cat(cat)


def _get_selected_by_cat(cat):
    """
    Генератор. Получить элементы в пользовательском выборе определенной категории

    :param cat: BuiltInCategory
    :type cat: DB.BuiltInCategory
    :return: Элементы опр. категории выбранные пользователем
    :rtype: DB.Element
    """

    for elem in get_selected():
        if elem.Category.Id == DB.Category.GetCategory(doc, cat).Id:
            yield elem


def transaction(f, doc=doc, msg="Dynamo Transaction"):
    def wrapped(*args, **kwargs):
        TransactionManager.Instance.EnsureInTransaction(doc)
        r = f(*args, **kwargs)
        TransactionManager.Instance.TransactionTaskDone()
        return r

    return wrapped


def main():
    WALLS = get_selected_by_cat(DB.BuiltInCategory.OST_Walls)
    START = IN[0]
    END = IN[1]
    return change_wall_join(WALLS, START, END)


def change_wall_join(walls, start=True, end=True):
    res = []
    for wall in walls:
        set_wall_join(wall, side=0, join=start)
        set_wall_join(wall, side=1, join=end)
        res.append(wall)
    return res


@transaction
def set_wall_join(wall, side=1, join=True):
    if DB.WallUtils.IsWallJoinAllowedAtEnd(wall, side) is not join:
        if join is True:
            DB.WallUtils.AllowWallJoinAtEnd(wall, side)
        else:
            DB.WallUtils.DisallowWallJoinAtEnd(wall, side)


if __name__ == '<module>':
    OUT = main()
# ----------------------------------------
стены = Watch(python_script)  # graph output
